# Grasshopper definition addition.ghx (Grasshopper 1.0.8)
# plug-ins: Logger

loggermanager = LoggerManager()
Y = GetNumber(AtLeast=1, AtMost=1, Maximum=1.797693135e+308, Minimum=-1.797693135e+308, TreeAccess=False)
X = GetNumber(AtLeast=1, AtMost=1, Maximum=1.797693135e+308, Minimum=-1.797693135e+308, TreeAccess=False)
addition = Addition(A=X, B=Y)
context_bake = ContextBake(Content=addition)
