# Grasshopper definition brep_points.ghx (Grasshopper 1.0.8)
# plug-ins: Logger

loggermanager = LoggerManager()
get_file_path = GetFilePath(AtLeast=1, AtMost=1, TreeAccess=False)
get_point = GetPoint(AtLeast=1, AtMost=1, Realtime=True, TreeAccess=False)
import_3dm = Import3DM(File=get_file_path, Layer="*", Name="*")
point = Point(get_point)
brep = Brep(import_3dm)
brep_closest_point = BrepClosestPoint(Point=point, Brep=brep)  # -> Point, Normal, Distance
point_in_brep = PointInBrep(Brep=brep, Point=point, Strict=False)
deconstruct_brep = DeconstructBrep(Brep=brep)  # -> Faces, Edges, Vertices
context_bake = ContextBake(Distance=brep_closest_point.Distance)
context_bake_2 = ContextBake(Content=point_in_brep)
context_bake_3 = ContextBake(Content=brep_closest_point.Normal)
context_bake_4 = ContextBake(Content=brep_closest_point.Point)
