# Grasshopper definition import_model.ghx (Grasshopper 1.0.8)
# plug-ins: Logger

loggermanager = LoggerManager()
get_file_path = GetFilePath(AtLeast=1, AtMost=1, TreeAccess=False)
import_3dm = Import3DM(File=get_file_path, Layer="*", Name="*")
context_bake = ContextBake(Content=import_3dm)
