# Grasshopper definition import_two_models.ghx (Grasshopper 1.0.8)

target = GetFilePath(AtLeast=1, AtMost=1, TreeAccess=False)
obstacle = GetFilePath(AtLeast=1, AtMost=1, TreeAccess=False)
import_target = Import3DM(File=target, Layer="*", Name="*")
import_obstacle = Import3DM(File=obstacle, Layer="*", Name="*")
context_bake = ContextBake(TargetGeometry=import_target)
context_bake_2 = ContextBake(ObstacleGeometry=import_obstacle)
