# Grasshopper definition variation.ghx (Grasshopper 1.0.8)
# plug-ins: Logger

loggermanager = LoggerManager()
get_boolean = GetBoolean(AtLeast=1, AtMost=1, FalseValue="False", TreeAccess=False, TrueValue="True")
get_point = GetPoint(AtLeast=1, AtMost=1, Realtime=True, TreeAccess=False)
get_string = GetString(AtLeast=1, AtMost=1, TreeAccess=False)
get_line = GetLine(AtLeast=1, AtMost=1, Realtime=True, TreeAccess=False)
Y = GetNumber(AtLeast=1, AtMost=1, Maximum=1.797693135e+308, Minimum=-1.797693135e+308, TreeAccess=False)
get_file_path = GetFilePath(AtLeast=1, AtMost=1, TreeAccess=False)
X = GetNumber(AtLeast=1, AtMost=1, Maximum=1.797693135e+308, Minimum=-1.797693135e+308, TreeAccess=False)
addition = Addition(A=X, B=Y)
context_bake = ContextBake(Content=get_boolean)
context_bake_2 = ContextBake(Content=get_line)
context_bake_3 = ContextBake(Content=get_point)
context_bake_4 = ContextBake(Content=get_string)
context_bake_5 = ContextBake(Content=get_file_path)
context_bake_6 = ContextBake(Content=addition)
